# Grasshopper definition json-to-viewer.gh (Grasshopper 1.0.7)
# plug-ins: ShapeDiverForGrasshopper

# Dynamic Input
visualization_type = ValueList({"Sun Hour": 0, "Indoor Comfort": 0, "Daylight Availbility": 0, "View Analysis": 0}, selected="Sun Hour")
analysis_period = ValueList({"Morning(6-10)": 0, "Noon(10-14)": 1, "Afternoon(14-18)": 2}, selected="Morning(6-10)")
concat = Concatenate(FragmentA="V", FragmentB=visualization_type, FragmentC="_")
panel = Panel("https://raw.githubusercontent.com/Kyungho0511/3d-scan-with-spatial-analysis/refs/heads/simulation-to-viewer/ViewerData/")
concat_2 = Concatenate(FragmentA="H", FragmentB=analysis_period, FragmentC=".txt")
panel_2 = Panel(concat)
panel_3 = Panel(concat_2)
concat_3 = Concatenate(FragmentA=panel, FragmentB=panel_2, FragmentH=panel_3)
panel_4 = Panel(concat_3)
mplane = MeshPlane(Boundary={Plane=PlaneXY(0, 0, 0), Size=Domain2(u=-10..10, v=-10..10)}, WidthCount=5, HeightCount=5)  # -> Mesh, Area
demesh = DeconstructMesh(Mesh=mplane.Mesh)  # -> Vertices, Faces, Colours, Normals
panel_5 = Panel(demesh.Colours)
panel_6 = Panel(demesh.Faces)
panel_7 = Panel(demesh.Vertices)
panel_8 = Panel(demesh.Normals)
constructjson = ConstructJSON(Data=panel_7, AddressString="vertices")
constructjson_2 = ConstructJSON(Object=constructjson, Data=panel_6, AddressString="faces")
constructjson_3 = ConstructJSON(Object=constructjson_2, Data=panel_5, AddressString="color")
# JSON Output
panel_9 = Panel(constructjson_3)
# JSON Input
# Local file //
# Online raw data link
path = FilePath("C:\Users\kewei\Documents\GitHub\3d-scan-with-spatial-analysis\JsonTest\sun_analysis.txt")
importtxt = ImportText(
    URI=panel_4,
    maximum_file_size=52428800,
    selected_file_formats="application/json,application/xml,application/x-step,text/csv,text/plain")
sdjsonparse = ShapeDiverJSONParse(JSON=importtxt)
data = Data(sdjsonparse)

# ----
# Faces
panel_10 = Panel("faces")
accessjson = AccessJSON(Object=data, AddressString=panel_10)
convertjson = ConvertJSON(Object=accessjson)

# ----
# Color
panel_11 = Panel("color")
accessjson_2 = AccessJSON(Object=data, AddressString=panel_11)
convertjson_2 = ConvertJSON(Object=accessjson_2)
# add more options for switch
# inbetween different visualization types
txt = Text(convertjson_2)

accessjson_3 = AccessJSON(Object=data, AddressString="vertices")
convertjson_3 = ConvertJSON(Object=accessjson_3)

txt_2 = Text(convertjson_3)
txt_3 = Text(convertjson)
color_filter = StreamFilter(Gate=0, Stream0=txt, Stream1="255,255,255")
gltf2material = GlTF20Material(
    BaseColorFactor=color_filter,
    MetallicFactor=0,
    RoughnessFactor=0.75,
    EmissiveFactor=RGB(0, 0, 0),
    AlphaMode="OPAQUE",
    AlphaCutoff=0.5,
    DoubleSided=True)
conmesh = ConstructMesh(Vertices=txt_2, Faces=txt_3, Colours=color_filter)  # -> graft(Mesh)
gltfdisplay = GlTF20Display(Geometry=conmesh, Material=gltf2material)
