# Grasshopper definition grasshopperPost.gh (Grasshopper 1.0.8)
# plug-ins: Pufferfish, Human

mesh = Mesh([<mesh referenced from the Rhino model> x4])
mesh_2 = Mesh([<mesh referenced from the Rhino model> x6])
mesh_3 = Mesh(<mesh referenced from the Rhino model>)
demesh = DeconstructMesh(Mesh=mesh)  # -> Vertices, Faces, Colours, Normals
demesh_2 = DeconstructMesh(Mesh=mesh_2)  # -> Vertices, Faces, Colours, Normals
cullpt = CullDuplicates(Points=flatten(demesh_2.Vertices), Tolerance=0.1, CullMode=1)  # -> Points, Indices, Valence
meshcp = MeshClosestPoint(Point=cullpt.Points, Mesh=mesh_3)  # -> Point, Index, Parameter
dist = Distance(PointA=cullpt.Points, PointB=meshcp.Point)
smaller = SmallerThan(FirstNumber=dist, SecondNumber=Slider(1, range=0..1))  # -> SmallerThan, OrEqualTo
cullpt_2 = CullDuplicates(Points=flatten(demesh.Vertices), Tolerance=0.1, CullMode=1)  # -> Points, Indices, Valence
dispatch = Dispatch(List=cullpt.Points, DispatchPattern=smaller.SmallerThan)  # -> ListA, ListB
plfit = PlaneFit(Points=cullpt_2.Points)  # -> Plane, Deviation
plfit_2 = PlaneFit(Points=dispatch.ListA)  # -> Plane, Deviation
bbox = BoundingBox(Content=dispatch.ListA, Plane=plfit_2.Plane, UnionBox=True)  # -> Box, Box_2
bbox_2 = BoundingBox(Content=cullpt_2.Points, Plane=plfit.Plane, UnionBox=True)  # -> Box, Box_2
deplane = DeconstructPlane(Plane=plfit.Plane)  # -> Origin, XAxis, YAxis, ZAxis
debrep = DeconstructBrep(Brep=bbox_2.Box)  # -> Faces, Edges, Vertices
debrep_2 = DeconstructBrep(Brep=bbox.Box)  # -> Faces, Edges, Vertices
area = Area(Geometry=debrep_2.Faces)  # -> Area, Centroid
area_2 = Area(Geometry=debrep.Faces)  # -> Area, Centroid
sort = SortList(Keys=area.Area, ValuesA=debrep_2.Faces)  # -> Keys, ValuesA
sort_2 = SortList(Keys=area_2.Area, ValuesA=debrep.Faces)  # -> Keys, ValuesA
number_slider = Slider(1, range=0..100)
item = ListItem(List=reverse(sort.ValuesA), Index=0, Wrap=True)
number_slider_2 = Slider(100, range=0..100)
item_2 = ListItem(List=reverse(sort_2.ValuesA), Index=0, Wrap=True)
amp = Amplitude(Vector=deplane.ZAxis, Amplitude=number_slider)
amp_2 = Amplitude(Vector=plfit_2.Plane, Amplitude=number_slider)
extr = Extrude(Base=item_2, Direction=amp)
division = Division(A=amp, B=-2)
extr_2 = Extrude(Base=item, Direction=amp_2)
mesh_4 = Mesh(<mesh referenced from the Rhino model>)
division_2 = Division(A=amp_2, B=-2)
medges = MeshEdges(Mesh=mesh_4)  # -> NakedEdges, InteriorEdges, NonManifoldEdges
move = Move(Geometry=extr, Motion=division)  # -> Geometry, Transform
move_2 = Move(Geometry=extr_2, Motion=division_2)  # -> Geometry, Transform
crv = Curve(medges.NakedEdges)
merge = Merge(Data1=graft(move.Geometry), Data2=graft(move_2.Geometry))
join = JoinCurves(Curves=crv, Preserve=False)
mdif = MeshDifference(MeshesA=mesh_4, MeshesB=merge)
msplit = MeshSplit(Mesh=mesh_4, Splitters=merge)
number_slider_3 = Slider(0, range=0..1)
rebmsh = RebuildMesh(
    Mesh=msplit,
    RebuildNormals=False,
    CullUnused=invert(False),
    UnifyNormals=False,
    FlipNormals=False,
    IdenticalCombine=False,
    WeldVertices=0)
mesh_5 = Mesh(join)
item_3 = ListItem(List=rebmsh, Index=0, Wrap=True)
filter = StreamFilter(Gate=number_slider_3, Stream0=mesh_4, Stream1=item_3)
item_4 = ListItem(Index=0, Wrap=True)
merge_2 = Merge(Data1=flatten(mesh_5), Data2=flatten(mesh_4))
merge_3 = Merge(Data1=flatten(mesh_5), Data2=flatten(item_3))
merge_4 = Merge(Data1=flatten(mesh_5), Data2=flatten(filter))
number_slider_4 = Slider(0.092, range=0..10)
medges_2 = MeshEdges(Mesh=merge_2)  # -> NakedEdges, InteriorEdges, NonManifoldEdges
filter_2 = StreamFilter(Gate=number_slider_3, Stream1=[item_2, item])
pt = ConstructPoint(XCoordinate=number_slider_4, YCoordinate=number_slider_4, ZCoordinate=0)
pt_2 = ConstructPoint(XCoordinate=number_slider_4, YCoordinate=number_slider_4, ZCoordinate=0)
crv_2 = Curve(medges_2.NakedEdges)
crv_3 = Curve(filter_2)
dash = DashPattern(Curve=crv_2, Pattern=pt)  # -> Dashes, Gaps
dash_2 = DashPattern(Curve=crv_3, Pattern=pt_2)  # -> Dashes, Gaps
preview = CustomPreview(Geometry=[item_3, mesh_5], Material=ColourSwatch(SwatchColor=RGBA(41, 116, 148, 67)))
previewlw = CustomPreviewLineweights(Geometry=dash.Gaps, Shader=ColourSwatch(SwatchColor=RGB(0, 0, 0)), Thickness=Slider(3.8, range=0..10), Absolute=False)
previewlw_2 = CustomPreviewLineweights(
    Geometry=dash_2.Gaps,
    Shader=ColourSwatch(SwatchColor=RGB(235, 0, 0)),
    Thickness=Slider(3.8, range=0..10),
    Absolute=False)
