# Grasshopper definition grasshopperPython.gh (Grasshopper 1.0.8)
# plug-ins: RhinoCodePluginGH

path = FilePath("C:\Users\mskepasts\Documents\GitHub\3d-scan-with-spatial-analysis\data\setup_8.parquet")
py3 = Python3Script(file_path=path, globalFilt=Slider(100000, range=0..100000), filt=Slider(2000, range=0..10000))  # -> out, wallPts, floorPts, ceilingPts, windowPts; inputs globalFilt: Int32, filt: Int32
# ---------- py3: Python ----------
#requirements: pandas
#requirements: pyarrow
# requirements: pandas
# requirements: pyvista 
#requirements: open3d 
import locale
locale.setlocale(locale.LC_ALL, 'en_US')
import pandas
import Rhino.Geometry as rg

import pyarrow.parquet as pq

def getPointsFromDF(df):
    x = df['x'].tolist()
    y = df['y'].tolist()
    z = df['z'].tolist()
    print(x)
    pts = []

    for i in range(len(x)):
        pt = rg.Point3d(x[i], y[i], z[i])
        pts.append(pt)
        i = i+1
    
    return pts



# Read the Parquet file
table = pq.read_table(file_path)

# Convert to a pandas DataFrame if needed
df = table.to_pandas()
df_sample = df.sample(n=globalFilt, random_state=1)


dfWalls = df_sample[df_sample['cat'] == 2]
dfFloor = df_sample[df_sample['cat'] == 1]
dfCeiling = df_sample[df_sample['cat'] == 0]
dfWindow =df_sample[df_sample['cat'] == 10]



df_sampleWalls = dfWalls.sample(n=filt, random_state=1)
df_sampleFloor = dfFloor.sample(n=filt, random_state=1)
df_sampleCeiling = dfCeiling.sample(n=filt, random_state=1)

wallPts = getPointsFromDF(df_sampleWalls)
floorPts = getPointsFromDF(df_sampleFloor)
ceilingPts = getPointsFromDF(df_sampleCeiling)
windowPts = getPointsFromDF(dfWindow)




volume = floorPts.delaunay_3d(alpha=2.)
shell = volume.extract_geometry()
shell.plot()
# ---------- end py3 ----------
pt = Point(py3.ceilingPts)
pt_2 = Point(py3.windowPts)
pt_3 = Point(py3.wallPts)
pt_4 = Point(py3.floorPts)
bvol = BoundaryVolume()
